vi "NXGtest.gviweb"   [LabVIEW NXG 5.0.0]
panel indicators:
  "LED": bool
  "차트": i32
diagram:
  # Place setup code before the loop. For example, perform initial data communication and wire the results into the loop.
  # Top-Level WebVIs usually contain a While Loop that never stops so that they can continue running as long as the web page is open in the user's web browser.
  while (iteration -> i1) {
    Not(x=FALSE) -> w1
    Quotient And Remainder(x=i1, y=20) -> (x-y*floor(x/y)=w2)
    Is Equal To 0(x=w2) -> w3
    Select(s=w3, t=w1, f=FALSE) -> w4
    $LED <- w4
    $"차트" <- w2
    Wait(time to wait=50)
    stop if FALSE
  }
